# Dynamo custom node Arrowhead Assigner.dyf (Dynamo 0.8.1.1823)
# category: Rhythm.Tools
# This node assings the arrowhead type for all text and keynote tags. There is an input for ones you want to exclude.

ConvertKeynoteTags = Input(ConvertKeynoteTags : bool=false)
code_block = CodeBlock { true; }
# note: Use get all keynote tags from Rhythm
keynoteTags = Custom[Collector.KeynoteTags](RunMe=code_block)  # This collects all of the keynote tags in the model. Similar to other nodes, but this doesn't use python.
code_block_2 = CodeBlock { {}; }
code_block_3 = CodeBlock(test=ConvertKeynoteTags, iftrue=keynoteTags, iffalse=code_block_2) { oldif(test,iftrue,iffalse); }
code_block_4 = CodeBlock { "Leader Arrowhead"; }
element_types = ElementTypes("ElementType")
# note: Selects the leader arrowhead to set
all_elements_of_type = ElementsOfType(element_types)
name = Element.Name(all_elements_of_type)
ArrowheadTypeName = Input(ArrowheadTypeName : string)
indexOf = IndexOf(name, ArrowheadTypeName)
getItemAtIndex = List.GetItemAtIndex(list=all_elements_of_type, index=indexOf)
setParameterByName = Element.SetParameterByName(element=code_block_3, parameterName=code_block_4, value=getItemAtIndex)
Keynote_Tags = Output(setParameterByName)
ConvertTextNotes = Input(ConvertTextNotes : bool=false)
element_types_2 = ElementTypes("TextNoteType")
all_elements_of_type_2 = ElementsOfType(element_types_2)
# note: Sets the leader arrowhead for all text notes
code_block_5 = CodeBlock { {}; }
code_block_6 = CodeBlock(test=ConvertTextNotes, iftrue=all_elements_of_type_2, iffalse=code_block_5) { oldif(test,iftrue,iffalse); }
name_2 = Element.Name(code_block_6)
TypesToExclude = Input(TypesToExclude : string = "dontexclude")
code_block_7 = CodeBlock { ","; }
split = String.Split(TypesToExclude, code_block_7)
boolean = BoolSelector(true)
contains = String.Contains(searchFor=split, ignoreCase=boolean)
map = List.Map(list=name_2, f_x=contains)
code_block_8 = CodeBlock { true; }
containsItem = List.ContainsItem(item=code_block_8)
map_2 = List.Map(list=map, f_x=containsItem)
filterByBoolMask = List.FilterByBoolMask(list=code_block_6, mask=map_2)
setParameterByName_2 = Element.SetParameterByName(element=filterByBoolMask.out, parameterName=code_block_4, value=getItemAtIndex)
TextNotes = Output(setParameterByName_2)
ConvertRoomTags = Input(ConvertRoomTags : bool=false)
get_all_tag_types = Custom[Get All Tag Types](RunMe=code_block)  # This node collects the tag types in the model.
code_block_9 = CodeBlock { {}; }
code_block_10 = CodeBlock(test=ConvertRoomTags, iftrue=get_all_tag_types.Room_Tag_Types, iffalse=code_block_9) { oldif(test,iftrue,iffalse); }
ConvertDoorTags = Input(ConvertDoorTags : bool=false)
code_block_11 = CodeBlock(test=ConvertDoorTags, iftrue=get_all_tag_types.Door_Tag_Types, iffalse=code_block_9) { oldif(test,iftrue,iffalse); }
ConvertWindowTags = Input(ConvertWindowTags : bool=false)
code_block_12 = CodeBlock(test=ConvertWindowTags, iftrue=get_all_tag_types.Window_Tag_Types, iffalse=code_block_9) { oldif(test,iftrue,iffalse); }
ConvertWallTags = Input(ConvertWallTags : bool=false)
code_block_13 = CodeBlock(test=ConvertWallTags, iftrue=get_all_tag_types.Wall_Tag_Types, iffalse=code_block_9) { oldif(test,iftrue,iffalse); }
create = List.Create(code_block_10, code_block_11, code_block_12, code_block_13)
setParameterByName_3 = Element.SetParameterByName(element=create, parameterName=code_block_4, value=getItemAtIndex)
code_block_14 = CodeBlock(x=setParameterByName_3) { x[0]; x[1]; x[2]; x[3]; }
Room_Tags = Output(code_block_14.out0)
Door_Tags = Output(code_block_14.out1)
Window_Tags = Output(code_block_14.out2)
Wall_Tags = Output(code_block_14.out3)

# group: Credit to mark thorley for this definition. Download his awesome package zebra!
code_block_15 = CodeBlock()
# ---------- code_block_15.designscript (15 lines) ----------
def oldif(test,iftrue:var[]..[],
iffalse:var[]..[])
{
return = [Imperative]
{
if (test)
{
return = iftrue;
}
else
{
return = iffalse;
}
}
};
# ----------------------------------------
