# Dynamo custom node Element.AreaLocation.dyf (Dynamo 1.2.1.3083)
# category: Rhythm.Revit.Elements.Element
# This node will determine what area (area plans) an element is located within. Made possible thanks to clockwork. :)

element = Input()
code_block = CodeBlock(element=element) { element; }
categories = Categories("Areas")
all_elements_of_category = ElementsOfCategory(categories)
areaType = Input(areaType : string ="")  # specify area type to collect. leave blank for all areas.

# group: Added to be able to specify area type to check.
string = StringInput("")
eq = string == areaType
code_block_2 = CodeBlock { "Area Type"; }
getParameterValueByName = Element.GetParameterValueByName(element=all_elements_of_category, parameterName=code_block_2)
eq_2 = getParameterValueByName == areaType

count = Count(getParameterValueByName)
cycle = List.Cycle(list=eq, amount=count)

# group (continued): Added to be able to specify area type to check.
if_ = If(test=eq, true=cycle, false=eq_2)
filterByBoolMask = List.FilterByBoolMask(list=all_elements_of_category, mask=if_)

RunMe = Input(RunMe : bool = false)  # This is a toggle. Use a boolean to make this node run.
toggle = Custom[Rhythm.Toggle](list=filterByBoolMask.in, boolean=RunMe)  # Toggle that offers two outputs. Created for Dynamo 0.8.1 because of changes to the "IF" node
code_block_3 = CodeBlock { 1; }
chop = List.Chop(list=toggle.in, lengths=code_block_3)
getLocation = Element.GetLocation(code_block)
count_2 = Count(getLocation)
cycle_2 = List.Cycle(list=chop, amount=count_2, lacing=Longest)
count_3 = Count(cycle_2)
cycle_3 = List.Cycle(list=code_block, amount=count_3)

# group: Based off of code generously provided by Andreas Dieckmann. (Clockwork)
python_script = Python(IN[0]=toggle.in)
# ---------- python_script.python (41 lines) ----------
import clr
clr.AddReference('ProtoGeometry')
from Autodesk.DesignScript.Geometry import *

# Import ToDSType(bool) extension method
clr.AddReference("RevitNodes")
import Revit
clr.ImportExtensions(Revit.Elements)
clr.ImportExtensions(Revit.GeometryConversion)


# Import DocumentManager and TransactionManager
clr.AddReference("RevitServices")
import RevitServices
from RevitServices.Persistence import DocumentManager
from RevitServices.Transactions import TransactionManager

from System.Collections.Generic import *

# Import RevitAPI
clr.AddReference("RevitAPI")
import Autodesk

doc = DocumentManager.Instance.CurrentDBDocument
uiapp = DocumentManager.Instance.CurrentUIApplication
app = uiapp.Application

items = UnwrapElement(IN[0])
view = doc.ActiveView
elementlist = list()
maxlist = list()
minlist = list()

for item in items:
	try:
		elementlist.append(item.BoundingBox[view])
		maxlist.append(item.BoundingBox[view].Max.ToPoint())
		minlist.append(item.BoundingBox[view].Min.ToPoint())
	except:
		pass
OUT = (elementlist,maxlist,minlist);
# ----------------------------------------
code_block_4 = CodeBlock(seq=python_script) { BoundingBox.ByCorners(seq[1],seq[2]); }

contains = BoundingBox.Contains(code_block_4, getLocation, lacing=CrossProduct)
flatten = Flatten(contains)
filterByBoolMask_2 = List.FilterByBoolMask(list=cycle_3, mask=flatten)
elements = Output(filterByBoolMask_2.in)  # This outputs elements that actually have an area location.
filterByBoolMask_3 = List.FilterByBoolMask(list=cycle_2, mask=contains)
flatten_2 = Flatten(filterByBoolMask_3.in)
area_location = Output(flatten_2)
