# Dynamo custom node Rhythm.3DRoomTags.dyf (Dynamo 1.3.0.875)
# category: Rhythm.Tools
# This node will generate 3D room tags for all rooms in the model. (RFA in extra folder in Dynamo download)

ThreeDRoomTag = Input(ThreeDRoomTag : FamilyType)
RunMe = Input(RunMe : bool=false)
python_script = Python(IN[0]=RunMe)
# ---------- python_script.python (41 lines) ----------
#Copyright(c) 2017, john pierson
# @60secondrevit, http://sixtysecondrevit.com

import clr
clr.AddReference('ProtoGeometry')
from Autodesk.DesignScript.Geometry import *

# Import DocumentManager and TransactionManager
clr.AddReference("RevitServices")
import RevitServices
from RevitServices.Persistence import DocumentManager
from RevitServices.Transactions import TransactionManager

# Import RevitAPI
clr.AddReference("RevitAPI")
import Autodesk
from Autodesk.Revit.DB import *
clr.AddReference("RevitNodes")


doc = DocumentManager.Instance.CurrentDBDocument
uiapp = DocumentManager.Instance.CurrentUIApplication
app = uiapp.Application

from System.Collections.Generic import *


#The inputs to this node will be stored as a list in the IN variable.
dataEnteringNode = IN
phase = UnwrapElement(IN[0])
collector = FilteredElementCollector(doc)
rooms = collector.OfCategory(BuiltInCategory.OST_Rooms).ToElements()

roomInstances = []
if IN[0] == True:
	for i in rooms:
			if i.Area != 0:
				roomInstances.append(i)
else:
	roomInstances.append("set run me to true")
OUT = roomInstances
# ----------------------------------------
code_block = CodeBlock { "Phase"; }
getParameterValueByName = Element.GetParameterValueByName(element=python_script, parameterName=code_block)
name = Element.Name(getParameterValueByName)
Phase = Input()
toggle = Custom[Rhythm.Toggle](list=Phase, boolean=RunMe)  # Toggle that offers two outputs. Created for Dynamo 0.8.1 because of changes to the "IF" node
type = Object.Type(toggle.in)
code_block_2 = CodeBlock { "System.String"; }
eq = type == code_block_2
name_2 = Element.Name(toggle.in)
if_ = If(test=eq, true=toggle.in, false=name_2)
eq_2 = name == if_  # lacing=Longest

# group: This area filters for user selected phase
filterByBoolMask = List.FilterByBoolMask(list=python_script, mask=eq_2)

# group: Room locations and parameters.
location = Room.Location(filterByBoolMask.in)
number = Room.Number(filterByBoolMask.in)

code_block_3 = CodeBlock { "Name"; }
getParameterValueByName_2 = Element.GetParameterValueByName(element=filterByBoolMask.in, parameterName=code_block_3)

# group: Creates tag and sets parameters.
byPoint = FamilyInstance.ByPoint(familyType=ThreeDRoomTag, point=location)
code_block_4 = CodeBlock { "Name"; "Number"; }
setParameterByName = Element.SetParameterByName(element=byPoint, parameterName=code_block_4.out1, value=number)
setParameterByName_2 = Element.SetParameterByName(element=setParameterByName, parameterName=code_block_4.out0, value=getParameterValueByName_2)

clean = Custom[Output.Clean](input=setParameterByName_2)  # This will return a single value or list from one input.
ThreeDRoomTags = Output(clean)
