# Dynamo custom node Select Elements By Curve.dyf (Dynamo 1.3.2.2480)
# category: Rhythm.Revit.Selection.Selection.Actions
# This will select model elements in the current view in the order that a curve is drawn through them.

# group: inputs
category = Input()
modelCurve = Input()

python_script = Python(IN[0]=category)
# ---------- python_script.python (36 lines) ----------
#Copyright(c) 2017, john pierson
# @60secondrevit, http://sixtysecondrevit.com

import clr
clr.AddReference('ProtoGeometry')
from Autodesk.DesignScript.Geometry import *

# Import DocumentManager and TransactionManager
clr.AddReference("RevitServices")
import RevitServices
from RevitServices.Persistence import DocumentManager
from RevitServices.Transactions import TransactionManager

# Import RevitAPI
clr.AddReference("RevitAPI")
import Autodesk
from Autodesk.Revit.DB import *

doc = DocumentManager.Instance.CurrentDBDocument
uiapp = DocumentManager.Instance.CurrentUIApplication
app = uiapp.Application

from System.Collections.Generic import *


#The inputs to this node will be stored as a list in the IN variable.
dataEnteringNode = IN
cat = UnwrapElement(IN[0])
view = doc.ActiveView

collector = FilteredElementCollector(doc,view.Id)
rooms = collector.OfCategoryId(cat.Id).WhereElementIsNotElementType().OfCategoryId(cat.Id).ToElements()



OUT = rooms
# ----------------------------------------

# group: Select the Spline
curve = CurveElement.Curve(modelCurve)

# group: Filter for elements that touch the spline (and also find the piece of the spline that passes through each element)
geometry = Element.Geometry(python_script)
flatten = Flatten(geometry)
intersect = Geometry.Intersect(geometry=flatten, other=curve)
isEmpty = List.IsEmpty(intersect@L2)
# note: Room elements that touch the spline
filterByBoolMask = List.FilterByBoolMask(list=python_script, mask=isEmpty)
# note: Part of the spline that passes through each room
filterByBoolMask_2 = List.FilterByBoolMask(list=intersect, mask=isEmpty)
# note: First of possibly multiple intersections
firstItem = List.FirstItem(filterByBoolMask_2.out@L2)

# group: Sort the elements along the spline
# note: For the piece of the spline that belongs to each element, find the location of its start point along the original spline.
# To do this, find the parameter along the original spline where each element-point lies, which will be a number between 0 and 1.
pointAtParameter = Curve.PointAtParameter(curve=firstItem)
parameterAtPoint = Curve.ParameterAtPoint(curve=curve, point=pointAtParameter)
sortIndexByValue = SortIndexByValue(parameterAtPoint)
getItemAtIndex = List.GetItemAtIndex(list=filterByBoolMask.out, index=sortIndexByValue)

element = Output(getItemAtIndex)
